# Grasshopper definition OffsetPattern.gh (Grasshopper 1.0.7)
# plug-ins: Pufferfish, Clipper

# ----
# Offset
number_slider = Slider(7.3, range=0..20)
c_offset = CSharpScript(dist=number_slider)  # -> EvenLns, OddLns; inputs Curves: list of Curve, dist: Double
# ---------- c_offset: C# ----------
    var Lns = LineOffset(Curves, dist);
    EvenLns = Lns.Item1;
    OddLns = Lns.Item2;
# ---------- c_offset: C# additional code ----------
  public Tuple<List<Curve>,List<Curve>> LineOffset(List<Curve> x, double y)
  {
    Point3d origin = new Point3d(0, 0, 0);
    Vector3d vectxy = new Vector3d(0, 0, 0);
    Plane xy = new Plane(origin, vectxy);
    List<Curve> offset = new List<Curve>(x.Count);
    List<Curve> evenLns = new List<Curve>(x.Count);
    List<Curve> oddLns = new List<Curve>(x.Count);

    for (int i = 0; i < x.Count ;i++)
    {
      Curve[] off = x[i].Offset(xy, y, 0.0, 0);
      offset.AddRange(off);
    }

    for (int j = 0; j < offset.Count; j++)
    {
      if(j % 2 == 0){
        evenLns.Add(offset[j]);
      }else{
        oddLns.Add(offset[j]);
      }
    }
    return Tuple.Create(evenLns, oddLns);
  }
# ---------- end c_offset ----------

# ----
# Test Trim Curve
c_script = CSharpScript()  # -> out, A; inputs CurvesRef: list of Curve
# ---------- c_script: C# usings ----------
using Rhino.Geometry.Intersect;
using System.Linq;
using System.Text;
using System.Threading.Tasks;
using System.Runtime.Remoting;
using Rhino.Input;
using Rhino.Input.Custom;
using Rhino.DocObjects.Tables;
# ---------- c_script: C# ----------
    A = Trimmer(CurvesRef);
# ---------- c_script: C# additional code ----------
  private List<Curve> Trimmer (List<Curve>CurveRef)
  {
    List<Curve> trimCrvs = new List<Curve>();

    for(int i = 0; i < CurveRef.Count - 1; i++){
      List < double > cutParams = new List<double>();
      CurveIntersections crvInt = Intersection.CurveCurve(CurveRef[i], CurveRef[i + 1], 0.001, 0.0);
      cutParams.AddRange(from e in crvInt where e.IsPoint select e.ParameterA);
      if(2 == cutParams.Count)
      {
        cutParams.Sort();
        Curve trimCrv = CurveRef[i].Trim(cutParams[0], cutParams[1]);
        trimCrvs.Add(trimCrv);
      }
    }
    return trimCrvs;
  }
# ---------- end c_script ----------

c_script_2 = CSharpScript(
    size=Slider(74.319, range=0..100),
    cenX=Slider(20, range=0..20),
    cenY=Slider(14, range=0..15),
    delta=Slider(20, range=0..37.1595),
    theta=Slider(40, range=0..75),
    DEF=Slider(0.07, range=0..0.1))  # -> A; inputs size: Double, cenX: Double, cenY: Double, delta: Double, theta: Double, DEF: Double
# ---------- c_script_2: C# usings ----------
using Rhino.Collections;
using System.Linq;
# ---------- c_script_2: C# ----------
    Tiling th;
    th = new Tiling();

    /////////// -SLIDERS MAX & MIN LIMITS - ///////////
    double DeltaMAX = size * 0.5;
    double ThetaMAX = 75;
    double DEFMAX = 0.1;

    var inputDelta = Component.Params.Input[3].Sources[0]; //get the first thing connected to the first input of this component
    var sliderD = inputDelta as Grasshopper.Kernel.Special.GH_NumberSlider; //try to cast that thing as a slider

    if (sliderD != null) //if the component was successfully cast as a slider
    {
      sliderD.Slider.Minimum = 0;
      sliderD.Slider.Maximum = (decimal) DeltaMAX;
    }

    var inputTheta = Component.Params.Input[4].Sources[0];
    var sliderT = inputTheta as Grasshopper.Kernel.Special.GH_NumberSlider;

    if (sliderT != null)
    {
      sliderT.Slider.Minimum = 0;
      sliderT.Slider.Maximum = (decimal) ThetaMAX;
    }

    var inputDEF = Component.Params.Input[5].Sources[0];
    var sliderDEF = inputDEF as Grasshopper.Kernel.Special.GH_NumberSlider;

    if (sliderDEF != null)
    {
      sliderDEF.Slider.Minimum = 0;
      sliderDEF.Slider.Maximum = (decimal) DEFMAX;
    }

    /////////////// -RENDERING- ///////////////////

    A = th.TilingHex(size, cenX, cenY, delta, theta, DEF);
# ---------- c_script_2: C# additional code ----------
  public class Tiling
  {
    List<Hexagon> hex;

    public Tiling()
    {
      hex = new List<Hexagon>();
    }

    public List<LineCurve> TilingHex(double _size, double _xNumCell, double _yNumCell, double _delta, double _theta, double _DEF)  ////// MATRIX CREATION
    {
      double h = 2 * _size;
      double w = Math.Sqrt(3) * _size;
      double vertCent = h * 0.75;
      double matX = w * _xNumCell;
      double matY = h * _yNumCell;
      int row = 0;
      double plus = 0;
      List<LineCurve> lc = new List<LineCurve>();

      for (double cenY = h; cenY <= matY; cenY += vertCent)
      {
        double offX = ((row % 2) == 0) ? w : w / 2;

        for (double cenX = offX; cenX <= matX; cenX += w)
        {
          hex.Add(new Hexagon(_size, cenX, cenY, _delta, _theta + plus)); ////EACH INSTANCE OF AN HEXAGON IN THE MATRIX
          plus += _DEF; /// PARQUETE DEFORMATION
        }
        row++;
      }
      for (int i = 0; i < hex.Count; i++)
      {
        lc.AddRange(hex[i].HexLns());
      }
      return lc;
    }
  }

  /////////////// --HANKIN ALGORITHM-- //////////////////////
  ///// "IF" POLIGONO REGULAR
  //// GENERAR UN "IF" EN CASO DE QUE EL POLIGONO TENGA MAS--
  /// -- DE "X" # DE LADOS PARA AGREGAR HANKIN CADA TERCER LADO
  //

  class Hankin
  {
    int sides;
    Point3d[] pts;
    double delta;
    double theta;

    public Hankin(Point3d[] _pts, int _sides, double _delta, double _theta)
    {
      this.pts = _pts;
      this.delta = _delta;
      this.theta = _theta;
      this.sides = _sides;
    }

    public Tuple <List<LineCurve>, List<LineCurve>> Lines()
    {
      Vector3d midH = new Vector3d();
      List<LineCurve> h1 = new List<LineCurve>(sides);
      List<LineCurve> h2 = new List<LineCurve>(sides);

      for (int i = 0; i < pts.Length - 1; i++)
      {
        midH = new Vector3d(pts[i] + pts[i + 1]);
        midH = Vector3d.Multiply(midH, 0.5);
        Vector3d m1 = new Vector3d(pts[i] - midH);
        Vector3d m2 = new Vector3d(pts[i + 1] - midH);

        double baseLen = m1.Length + delta;
        double intAng = (sides - 2) * (Math.PI / sides);
        double alpha = intAng * 0.5;
        double beta = Math.PI - alpha - RhinoMath.ToRadians(theta);
        double len = Math.Sin(alpha) * ((baseLen) / Math.Sin(beta));

        Vector3d offset1 = midH;
        Vector3d offset2 = midH;

        if (delta > 0)
        {
          m1.Unitize();
          m2.Unitize();
          m1 = Vector3d.Multiply(m1, delta);
          m2 = Vector3d.Multiply(m2, delta);
          offset1 = Vector3d.Add(m2, midH);
          offset2 = Vector3d.Add(m1, midH);
        }

        m1.Unitize();
        m2.Unitize();

        m1.Rotate(RhinoMath.ToRadians(-theta), Vector3d.ZAxis);
        m2.Rotate(RhinoMath.ToRadians(theta), Vector3d.ZAxis);

        m1.Unitize();
        m2.Unitize();
        m1 = Vector3d.Multiply(m1, len);
        m2 = Vector3d.Multiply(m2, len);

        Vector3d hlen = Vector3d.Add(offset1, m1);
        Vector3d hlen2 = Vector3d.Add(offset2, m2);

        h1.Add(new LineCurve(new Point3d(offset1), new Point3d(hlen)));
        h2.Add(new LineCurve(new Point3d(offset2), new Point3d(hlen2)));
      }
      return Tuple.Create(h1, h2);
    }

    public List<LineCurve> Ends()
    {
      List<LineCurve> lns = new List<LineCurve>(2);
      Vector3d midH = new Vector3d();
      midH = new Vector3d(pts[sides - 1] + pts[0]);
      midH = Vector3d.Multiply(midH, 0.5);
      Vector3d m1 = new Vector3d(pts[sides - 1] - midH);
      Vector3d m2 = new Vector3d(pts[0] - midH);

      double baseLen = m1.Length + delta;
      double intAng = (sides - 2) * (Math.PI / sides);
      double alpha = intAng * 0.5;
      double beta = Math.PI - alpha - RhinoMath.ToRadians(theta);
      double len = Math.Sin(alpha) * ((baseLen) / Math.Sin(beta));

      Vector3d offset1 = midH;
      Vector3d offset2 = midH;

      if (delta > 0)
      {
        m1.Unitize();
        m2.Unitize();
        m1 = Vector3d.Multiply(m1, delta);
        m2 = Vector3d.Multiply(m2, delta);
        offset1 = Vector3d.Add(m2, midH);
        offset2 = Vector3d.Add(m1, midH);
      }

      m1.Unitize();
      m2.Unitize();

      m1.Rotate(RhinoMath.ToRadians(-theta), Vector3d.ZAxis);
      m2.Rotate(RhinoMath.ToRadians(theta), Vector3d.ZAxis);

      m1.Unitize();
      m2.Unitize();
      m1 = Vector3d.Multiply(m1, len);
      m2 = Vector3d.Multiply(m2, len);

      Vector3d hlen = Vector3d.Add(offset1, m1);
      Vector3d hlen2 = Vector3d.Add(offset2, m2);

      LineCurve h1 = (new LineCurve(new Point3d(offset1), new Point3d(hlen)));
      LineCurve h2 = (new LineCurve(new Point3d(offset2), new Point3d(hlen2)));
      lns.Add(h1);
      lns.Add(h2);
      return lns;
    }
  }

  ///////////// --Hexagon Cell Creation-- /////////////
  /////////////
  //////

  class Hexagon
  {
    double cenX;
    double cenY;
    double size;
    double delta;
    double theta;
    int sides;

    public Hexagon(double _size, double _cenX, double _cenY, double _delta, double _theta)
    {
      this.cenX = _cenX;
      this.cenY = _cenY;
      this.size = _size;
      this.delta = _delta;
      this.theta = _theta;
      sides = 6;
    }

    public Point3d[] HexPts()
    {
      Point3d[] pts = new Point3d[sides];

      for (int i = 0; i < sides; i++)
      {
        double angle_deg = 60 * i - 30;
        double angle_rad = Math.PI / 180 * angle_deg;
        double edX = cenX + size * Math.Cos(angle_rad);
        double edY = cenY + size * Math.Sin(angle_rad);
        pts[i] = new Point3d(edX, edY, 0);
      }
      return pts;
    }

    public List<LineCurve> HexLns()
    {
      Hankin H;
      H = new Hankin(HexPts(), sides, delta, theta);
      List<LineCurve> lns = new List<LineCurve>(sides);
      List<LineCurve> lnsI1 = new List<LineCurve>(sides);
      List<LineCurve> lnsI2 = new List<LineCurve>(sides);
      List<LineCurve> lnsI3 = new List<LineCurve>(sides);

      for (int j = 0; j < sides - 1; j++)
      {
        lns.Add(new LineCurve(HexPts()[j], HexPts()[j + 1]));
      }
      lns.Add(new LineCurve(HexPts()[sides - 1], HexPts()[0]));
      lnsI1 = H.Lines().Item1;
      lnsI2 = H.Lines().Item2;
      lnsI3 = H.Ends();
      var Lines = lns.Concat(lnsI1).Concat(lnsI2).Concat(lnsI3).ToList();

      return Lines;
    }
  }
# ---------- end c_script_2 ----------
merge = Merge(Data1=c_script_2)
polyoffset = PolylineOffset(
    Polylines=flatten(merge),
    Distance=Slider(3, range=0..10),
    Plane=Plane(origin=(0, 0, 0), x=(0, 0, 0), y=(0, 0, 0)),
    Tolerance=0.001,
    ClosedFillet=0,
    OpenFillet=0,
    Miter=2)  # -> Contour, Holes
debrep = DeconstructBrep(Brep=polyoffset.Contour)  # -> Faces, Edges, Vertices
recfit = RectangleFit(Points=debrep.Vertices)
explode = Explode(Curve=recfit, Recursive=True)  # -> Segments, Vertices
# Size Frame V.
number_slider_2 = Slider(-100, range=-1000..100)
# Size Frame H.
number_slider_3 = Slider(-100, range=-1000..100)
cull = CullPattern(List=explode.Segments, CullPattern=[False, True])
cull_2 = CullPattern(List=explode.Segments, CullPattern=[True, False])
offset = OffsetCurve(Curve=cull_2, Distance=number_slider_3, Plane=PlaneXY(0, 0, 0), Corners=1)
offset_2 = OffsetCurve(Curve=cull, Distance=number_slider_2, Plane=PlaneXY(0, 0, 0), Corners=1)  # -> flatten(Curve)
num = Number(100)
ext = ExtendCurve(Curve=[offset_2, offset], Type=0, Start=num, End=num)
join = JoinCurves(Curves=polyoffset.Holes, Preserve=False)
ccx = CurveCurve(CurveA=offset_2, CurveB=offset)  # -> Points, ParamsA, ParamsB
ptstrimcrv = PointsTrimCurve(Curve=flatten(ext), Points=flatten(ccx.Points), Flip=True)  # -> Trimmed, SubDomains, Intersected
join_2 = JoinCurves(Curves=flatten(ptstrimcrv.Trimmed), Preserve=False)

graft = GraftTree(Tree=join, IncludeEmptyLists=True, IncludeNullItems=True)
ccx_2 = CurveCurve(CurveA=graft, CurveB=join_2)  # -> Points, ParamsA, ParamsB

x_tremez = Extremes(Curve=graft, Plane=PlaneXY(0, 0, 0))  # -> Highest, Lowest
incurve = PointInCurve(Point=x_tremez.Highest, Curve=join_2)  # -> Relationship, Point
shatter = Shatter(Curve=graft, Parameters=ccx_2.ParamsA)
expression = Expression(x=incurve.Relationship, Expression="x=2")
num_2 = Number(0.5)
eval = EvaluateLength(Curve=shatter, Length=num_2, Normalized=True)  # -> Point, Tangent, Parameter
dispatch = Dispatch(List=graft, DispatchPattern=expression)  # -> ListA, ListB
crv = Curve(dispatch.ListA)
incurve_2 = PointInCurve(Point=eval.Point, Curve=join_2)  # -> flatten(Relationship), Point
expression_2 = Expression(x=incurve_2.Relationship, Expression="x=2")
dispatch_2 = Dispatch(List=flatten(shatter), DispatchPattern=expression_2)  # -> ListA, ListB
cull_i = CullIndex(List=crv, Indices=ccx_2.ParamsA, Wrap=True)  # -> flatten(List)
crv_2 = Curve(dispatch_2.ListA)
join_3 = JoinCurves(Curves=[cull_i, crv_2], Preserve=False)

graft_2 = GraftTree(Tree=join_2, IncludeEmptyLists=True, IncludeNullItems=True)
ccx_3 = CurveCurve(CurveA=graft_2, CurveB=join_3)  # -> Points, ParamsA, ParamsB
# Cambiar entre True-False y False-True
# para ajustar curvas dependiendo de
# diseño
shatter_2 = Shatter(Curve=graft_2, Parameters=flatten(ccx_3.ParamsA))
cull_3 = CullPattern(List=shatter_2, CullPattern=True)
# Inside Frame
num_3 = Number(1)
# Interior Pattern
join_4 = JoinCurves(Curves=[join_3, cull_3], Preserve=False)
offset_3 = OffsetCurve(Curve=join_2, Distance=Slider(0, range=0..100), Plane=PlaneXY(0, 0, 0), Corners=num_3)
num_4 = Number(26)
num_5 = Number(0)
cull_i_2 = CullIndex(List=flatten(join_4), Indices=num_5, Wrap=True)  # disabled
item = ListItem(List=flatten(join_4), Index=num_4, Wrap=True)  # disabled
# Heigth Extrusion
number_slider_4 = Slider(5, range=0..10)  # disabled
srf = Surface(item)  # disabled
vec = VectorXYZ(XComponent=0, YComponent=0, ZComponent=number_slider_4)  # -> Vector, Length; disabled
extr = Extrude(Base=srf, Direction=vec.Vector)  # disabled
extr_2 = Extrude(Base=cull_i_2, Direction=vec.Vector)  # disabled
sdiff = SolidDifference(BrepsA=extr, BrepsB=extr_2)  # disabled
filedge = FilletEdge(Shape=sdiff, Blend=1, Metric=0)  # disabled
